# Dynamo graph Connector.ConnectTo.dyn (Dynamo 2.16.1.2727)
# packages: OpenMEP 1.0.0

select_model_element = DSModelElementSelection()  # 1 picked in the model
getConnectors = OpenMEP.ConnectorManager.Connector.GetConnectors(element=select_model_element)
select_model_element_2 = DSModelElementSelection()  # 1 picked in the model
getUnusedConnectors = OpenMEP.ConnectorManager.Connector.GetUnusedConnectors(element=select_model_element_2)
connectTo = OpenMEP.ConnectorManager.Connector.ConnectTo(connector=getConnectors, connectorFrom=getUnusedConnectors)
