# Dynamo graph Connector.Owner.dyn (Dynamo 2.16.1.2727)
# packages: Exyte 1.0.1

select_model_element = DSModelElementSelection()  # 1 picked in the model
getConnectors = Exyte.Revit.MEPModel.Connector.GetConnectors(element=select_model_element)
owner = Exyte.Revit.MEPModel.Connector.Owner(connector=getConnectors)
