# Dynamo graph Connector.SetAngle.dyn (Dynamo 2.16.1.2727)
# packages: Exyte 1.0.1

select_model_element = DSModelElementSelection()  # 1 picked in the model
getConnectors = Exyte.Revit.MEPModel.Connector.GetConnectors(element=select_model_element)
code_block = CodeBlock { 30; }
setAngle = Exyte.Revit.MEPModel.Connector.SetAngle(connector=getConnectors, angle=code_block)
