# Dynamo graph Pipe.CreateByLine.dyn (Dynamo 2.16.1.2727)
# packages: OpenMEP 1.0.0

boolean = BoolSelector(true)
getAllPipeSystemTypes = OpenMEP.Element.PipingSystem.GetAllPipeSystemTypes(toggle=boolean)
code_block = CodeBlock(x=getAllPipeSystemTypes) { x[2]; x.Name; }
getAllPipeTypes = OpenMEP.Element.PipeType.GetAllPipeTypes()
code_block_2 = CodeBlock(x=getAllPipeTypes) { x[1]; x.Name; }
levels = Levels("Level 1")
byCoordinates = Point.ByCoordinates()
code_block_3 = CodeBlock { 10; }
byCoordinates_2 = Point.ByCoordinates(y=code_block_3)
byStartPointEndPoint = Line.ByStartPointEndPoint(startPoint=byCoordinates, endPoint=byCoordinates_2)
create = OpenMEP.Element.Pipe.Create(systemType=code_block.out0, pipeType=code_block_2.out0, level=levels, line=byStartPointEndPoint)
