# Dynamo graph Point.ProjectOntoPlane.dyn (Dynamo 2.18.0.2986)
# packages: OpenMEP 1.0.0

integer_slider = IntegerSlider(8, range=0..100 step 1)
byCoordinates = Point.ByCoordinates(x=integer_slider, y=integer_slider)
integer_slider_2 = IntegerSlider(17, range=0..100 step 1)
byCoordinates_2 = Point.ByCoordinates(x=integer_slider_2)
XAxis = Vector.XAxis()
byOriginNormal = Plane.ByOriginNormal(origin=byCoordinates_2, normal=XAxis)
projectOntoPlane = OpenMEPSandbox.Geometry.Point.ProjectOntoPlane(point=byCoordinates, plane=byOriginNormal)
byStartPointEndPoint = Line.ByStartPointEndPoint(startPoint=byCoordinates, endPoint=projectOntoPlane)
YAxis = Vector.YAxis()
